# Grasshopper definition voronoy.gh (Grasshopper 1.0.7)
# plug-ins: Pufferfish, ShapeDiverForGrasshopper

width = GetNumber(Slider(2.5, range=1..3), AtLeast=1, AtMost=1, Maximum=1.797693135e+308, Minimum=-1.797693135e+308, TreeAccess=False)
height = GetNumber(Slider(1.8, range=1..3), AtLeast=1, AtMost=1, Maximum=1.797693135e+308, Minimum=-1.797693135e+308, TreeAccess=False)
sddp = ShapeDiverDocumentPayload({AbsoluteTolerance=0, AngleTolerance=0, DistanceDisplayPrecision=0, GltfVersion="Gltf2", GrasshopperVersion="1.0.0007", InputGroups="{}", OutputGroups="{}", RelativeTolerance=0, RhinoVersion="7.35.23346.11001", UnitSystem=0, VersionCreated="1.16.0.0", VersionSaved="1.16.0.0"})
xz = XZPlane(Origin=Point(0, 0, 0))
rectangle = Rectangle(Plane=xz, XSize=width, YSize=height, Radius=0)  # -> Rectangle, Length
area = Area(Geometry=rectangle.Rectangle)  # -> Area, Centroid
move2pt = MoveToPoint(Geometry=rectangle.Rectangle, PointA=area.Centroid, PointB=xz)  # -> Moved, Vector, Transform
pop2d = Populate2D(Region=move2pt.Moved, Count=Slider(120, range=80..160), Seed=Slider(1, range=1..10))
voronoi = Voronoi(Points=pop2d, Boundary=move2pt.Moved, BruteForceOverride=False)
list = ValueList({"Thick": 0.50, "Medium": 0.60, "Thin": 0.70}, selected="Thick")
area_2 = Area(Geometry=voronoi)  # -> Area, Centroid
type = GetString(list, AtLeast=1, AtMost=1, TreeAccess=False)
scale = Scale(Geometry=voronoi, Center=area_2.Centroid, Factor=type)  # -> Geometry, Transform
merge = Merge(Data1=voronoi, Data2=scale.Geometry)
param_viewer = ParamViewer(merge)
boundary = BoundarySurfaces(Edges=merge)
facen = FaceNormals(Mesh=boundary)  # -> Centers, flatten(Normals)
join = BrepJoin(Breps=boundary)  # -> flatten(Breps), Closed
number_slider = Slider(0.06, range=0..0.1)
item = ListItem(List=facen.Normals, Index=0, Wrap=True)
boundary_2 = BoundarySurfaces(Edges=scale.Geometry)
amp = Amplitude(Vector=item, Amplitude=number_slider)
facen_2 = FaceNormals(Mesh=boundary_2)  # -> Centers, flatten(Normals)
join_2 = BrepJoin(Breps=boundary_2)  # -> flatten(Breps), Closed
item_2 = ListItem(List=facen_2.Normals, Index=0, Wrap=True)
division = Division(A=number_slider, B="2")
subtraction = Subtraction(A=division, B=".005")
amp_2 = Amplitude(Vector=item_2, Amplitude=Slider(0.01, range=0..0.1))
extr = Extrude(Base=join.Breps, Direction=amp)
amp_3 = Amplitude(Vector=item_2, Amplitude=subtraction)
extr_2 = Extrude(Base=join_2.Breps, Direction=amp_2)
move = Move(Geometry=extr_2, Motion=amp_3)  # -> Geometry, Transform
brep_join = BrepJoin(Breps=move.Geometry)  # -> Breps, Closed
param_viewer_2 = ParamViewer(move.Geometry)
close_wall = GetBoolean(Toggle(False), AtLeast=1, AtMost=1, FalseValue="False", TreeAccess=False, TrueValue="True")
group = Group(Objects=[brep_join.Breps, extr])
pick_n_choose = PickNChoose(Pattern=close_wall, Stream0=extr, Stream1=group)
ungroup = Ungroup(Group=pick_n_choose)
number_slider_2 = Slider(1, range=0..1)  # disabled
list_length = ListLength(List=brep_join.Breps)  # disabled
subtraction_2 = Subtraction(A=list_length, B=number_slider_2)  # disabled
context_bake = ContextBake(CobogóWall=ungroup)
list_item = ListItem(List=ungroup, Index=list_length, Wrap=True)  # disabled
construct_domain = ConstructDomain(DomainStart=0, DomainEnd=subtraction_2)  # disabled
sub_list = SubList(List=ungroup, Domain=construct_domain, Wrap=True)  # -> List, Index; disabled
